# Grasshopper definition regular tetrahedron.gh (Grasshopper 1.0.7)

number_slider = Slider(7, range=0..100)
a_x_y = GhPythonScript(x=number_slider, y=Slider(2, range=0..100))  # -> out, a
# ---------- a_x_y: Python ----------
__author__ = "sator"
__version__ = "2023.04.26"

import rhinoscriptsyntax as rs

a = x * y
# ---------- end a_x_y ----------
a_x_y_2 = GhPythonScript(x=Slider(1, range=0..100), y=Slider(5, range=0..100))  # -> out, a
# ---------- a_x_y_2: Python ----------
__author__ = "sator"
__version__ = "2023.04.26"

import rhinoscriptsyntax as rs

a = x / y
# ---------- end a_x_y_2 ----------
radgrid = Radial(Plane=PlaneXY(0, 0, 0), Size=number_slider, ExtentR=Slider(1, range=0..100), ExtentP=Slider(5, range=0..100))  # -> Cells, Points; disabled
panel = Panel(radgrid.Points)
vec = VectorXYZ(XComponent=Slider(0, range=0..50), YComponent=Slider(0, range=0..50), ZComponent=Slider(0, range=0..50))  # -> Vector, Length
pi = Pi(Factor=a_x_y_2.a)
sqrt = SquareRoot(Value=Slider(2, range=0..50))
division = Division(A=sqrt, B=Slider(4, range=0..50))
item = ListItem(List=radgrid.Points, Index=Slider(0, range=0..100), Wrap=True)
panel_2 = Panel(item)
vec_2 = VectorXYZ(XComponent=Slider(0, range=0..50), YComponent=Slider(0, range=0..50), ZComponent=division)  # -> Vector, Length
rotate = Rotate(Geometry=radgrid.Points, Angle=pi, Plane=PlaneXY(0, 0, 0))  # -> Geometry, Transform
X = UnitX(Factor=1)
Y = UnitY(Factor=1)
Z = UnitZ(Factor=1)
_4face = GhPythonScript()  # -> out, a, b
# ---------- _4face: Python ----------
__author__ = "sator"
__version__ = "2023.04.28"

import rhinoscriptsyntax as rs
import math

faces = []
triangle_points = []

for i in range(0, 3):
    angle = 2.0 * math.pi / 3 * i
    triangle_points.append(rs.CreatePoint([math.cos(angle), math.sin(angle), 0]))

triangle_points.append(rs.CreatePoint([0, 0, math.sqrt(2)]));


faces.append(rs.AddSrfPt([triangle_points[2], triangle_points[1], triangle_points[0]]))
faces.append(rs.AddSrfPt([triangle_points[0], triangle_points[1], triangle_points[3]]))
faces.append(rs.AddSrfPt([triangle_points[1], triangle_points[2], triangle_points[3]]))
faces.append(rs.AddSrfPt([triangle_points[2], triangle_points[0], triangle_points[3]]))

a = faces
# ---------- end _4face ----------
ln = Line(StartPoint=X, EndPoint=vec.Vector)
panel_3 = Panel(rotate.Geometry)
vec_3 = VectorXYZ(XComponent=Slider(0, range=0..50), YComponent=Slider(0, range=0..50), ZComponent=Slider(0, range=0..50))  # -> Vector, Length
ln_2 = Line(StartPoint=Y, EndPoint=vec.Vector)
ln_3 = Line(StartPoint=Z, EndPoint=vec.Vector)
base_hexagon = SimpleMesh(Brep=radgrid.Cells)  # disabled
subtraction = Subtraction(A=vec_3.Vector, B=vec_2.Vector)
move = Move(Geometry=_4face.a, Motion=subtraction)  # -> Geometry, Transform
origin = VectorXYZ(XComponent=Slider(0, range=0..10), YComponent=Slider(0, range=0..10), ZComponent=Slider(0, range=0..10))  # -> Vector, Length
scale = Scale(Geometry=rotate.Geometry, Center=origin.Vector, Factor=Slider(2, range=0..10))  # -> Geometry, Transform
rad = Radians(Degrees=Slider(180, range=0..360))
rotax = RotateAxis(Geometry=move.Geometry, Angle=rad, Axis=ln)  # -> Geometry, Transform
vec2pt = Vector2Pt(PointA=scale.Geometry, PointB=origin.Vector, Unitize=False)  # -> Vector, Length
rad_2 = Radians(Degrees=Slider(125, range=0..360))
panel_4 = Panel(vec2pt.Vector)
python = GhPythonScript(x=base_hexagon, y=vec2pt.Vector)  # -> out, a
# ---------- python: Python ----------
__author__ = "sator"
__version__ = "2023.04.26"

import rhinoscriptsyntax as rs

a = []

a.append(x)

for p in y:
    print p
    
print "len(y) ={}".format(len(y))
for i in range(int((len(y) / 3))):
    print "i={}".format(i)
    print "({},{},{})".format(y[i])
        
    
    #rs.TransformObject(x, rs.XformTranslation(p))
    #a.append(x)
# ---------- end python ----------
rotax_2 = RotateAxis(Geometry=rotax.Geometry, Angle=rad_2, Axis=ln_2)  # -> Geometry, Transform
pcen = PolygonCenter(Polyline=rotax_2.Geometry)  # -> CenterV, CenterE, CenterA
del = DelaunayMesh(Points=reverse(pcen.CenterV), Plane=PlaneXY(0, 0, 0))
del_2 = DelaunayMesh(Points=pcen.CenterV, Plane=PlaneXY(0, 0, 0))
merge = Merge(Data1=del, Data2=del_2)
mjoin = MeshJoin(Meshes=merge)
faceb = FaceBoundaries(Mesh=mjoin)
boundary = BoundarySurfaces(Edges=faceb)
bvol = BoundaryVolume(Boundaries=rotax_2.Geometry)
bvol_2 = BoundaryVolume(Boundaries=boundary)
scale_2 = Scale(Geometry=bvol_2, Center=vec.Vector, Factor=Slider(3, range=0.001..10))  # -> Geometry, Transform
midpt = CurveMiddle()
sint = SolidIntersection(BrepsA=bvol, BrepsB=scale_2.Geometry)
edges = BrepEdges(Brep=sint)  # -> Naked, Interior, NonManifold
end = EndPoints(Curve=edges.Interior)  # -> Start, End
del_3 = DelaunayMesh(Plane=PlaneXY(0, 0, 0))
preview = CustomPreview(
    Geometry=sint,
    Material={diffuse=RGB(221, 160, 221), emission=RGB(66, 48, 66), shine=0.5, specular=RGB(255, 255, 255), transparency=0})
divlength = DivideLength(Curve=edges.Interior, Length=Slider(0.744, range=0.001..10))  # -> flatten(Points), Tangents, Parameters
debrep = DeconstructBrep(Brep=sint)  # -> Faces, Edges, Vertices
edges_2 = BrepEdges(Brep=sint)  # -> Naked, Interior, NonManifold
pcen_2 = PolygonCenter(Polyline=debrep.Faces)  # -> CenterV, CenterE, CenterA
crv = Curve(debrep.Edges)
midpt_2 = CurveMiddle(Curve=crv)
pdecon = Deconstruct(Point=midpt_2)  # -> XComponent, YComponent, ZComponent
sort = SortList(Keys=pdecon.ZComponent, ValuesA=crv)  # -> Keys, ValuesA
rev = ReverseList(List=sort.ValuesA)
item_2 = ListItem(List=rev, Index=Slider(0, range=0..10), Wrap=True)
partition = PartitionList(List=rev, Size=Slider(4, range=0..10))
midpt_3 = CurveMiddle(Curve=partition)
fcircle = CircleFit(Points=midpt_3)  # -> Circle, Radius, Deviation
crv_cp = CurveClosestPoint(Point=midpt_3, Curve=fcircle.Circle)  # -> Point, Parameter, Distance
sort_2 = SortList(Keys=crv_cp.Parameter, ValuesA=partition)  # -> Keys, ValuesA
crv_2 = Curve(flatten(sort_2.ValuesA))  # disabled
panel_5 = Panel(crv_2)
lng = ListLength(List=flatten(sort_2.ValuesA))
end_2 = EndPoints(Curve=sort_2.ValuesA)  # -> Start, End
midpt_4 = CurveMiddle(Curve=crv_2)
series = Series(Start=0, Step=1, Count=flatten(lng))
item_3 = ListItem(List=crv_2, Index=Slider(0, range=0..10), Wrap=True)
points = PointList(Points=midpt_4)
mod = Modulus(A=series, B=Slider(2, range=0..10))
dispatch = Dispatch(List=sort_2.ValuesA, DispatchPattern=mod)  # -> ListA, ListB
panel_6 = Panel(dispatch.ListA)
crv_3 = Curve(dispatch.ListB)
crv_4 = Curve(dispatch.ListA)
crv_5 = Curve(crv_4)
end_3 = EndPoints(Curve=crv_3)  # -> Start, End
pt = Point(end_3.End)
end_4 = EndPoints(Curve=crv_5)  # -> Start, End
pt_2 = Point(end_3.Start)
pdecon_2 = Deconstruct(Point=pt)  # -> XComponent, YComponent, ZComponent
pdecon_3 = Deconstruct(Point=pt_2)  # -> XComponent, YComponent, ZComponent
pt_3 = Point(end_4.End)
pt_4 = Point(end_4.Start)
pdecon_4 = Deconstruct(Point=pt_3)  # -> XComponent, YComponent, ZComponent
pdecon_5 = Deconstruct(Point=pt_4)  # -> XComponent, YComponent, ZComponent
larger = LargerThan(FirstNumber=pdecon_3.ZComponent, SecondNumber=pdecon_2.ZComponent)  # -> LargerThan, OrEqualTo
dispatch_2 = Dispatch(List=crv_3, DispatchPattern=larger.LargerThan)  # -> ListA, ListB
index = ItemIndex(List=crv_3, Item=dispatch_2.ListA)
smaller = SmallerThan(FirstNumber=pdecon_5.ZComponent, SecondNumber=pdecon_4.ZComponent)  # -> SmallerThan, OrEqualTo
dispatch_3 = Dispatch(List=crv_5, DispatchPattern=smaller.SmallerThan)  # -> ListA, ListB
index_2 = ItemIndex(List=crv_5, Item=dispatch_3.ListA)
flip = FlipCurve(Curve=dispatch_2.ListA)  # -> Curve, Flag
flip_2 = FlipCurve(Curve=dispatch_3.ListA)  # -> Curve, Flag
replace = ReplaceItems(List=crv_3, Item=flip.Curve, Indices=index, Wrap=False)
replace_2 = ReplaceItems(List=crv_5, Item=flip_2.Curve, Indices=index_2, Wrap=False)
midpt_5 = CurveMiddle(Curve=replace)
midpt_6 = CurveMiddle(Curve=replace_2)
pdecon_6 = Deconstruct(Point=midpt_5)  # -> XComponent, YComponent, ZComponent
pdecon_7 = Deconstruct(Point=midpt_6)  # -> XComponent, YComponent, ZComponent
smaller_2 = SmallerThan(FirstNumber=pdecon_6.ZComponent, SecondNumber=Slider(0, range=0..10))  # -> SmallerThan, OrEqualTo
dispatch_4 = Dispatch(List=replace, DispatchPattern=smaller_2.SmallerThan)  # -> ListA, ListB
index_3 = ItemIndex(List=replace, Item=dispatch_4.ListA)
smaller_3 = SmallerThan(FirstNumber=pdecon_7.ZComponent, SecondNumber=Slider(0, range=0..10))  # -> SmallerThan, OrEqualTo
dispatch_5 = Dispatch(List=replace_2, DispatchPattern=smaller_3.SmallerThan)  # -> ListA, ListB
index_4 = ItemIndex(List=replace_2, Item=dispatch_5.ListA)
flip_3 = FlipCurve(Curve=dispatch_4.ListA)  # -> Curve, Flag
flip_4 = FlipCurve(Curve=dispatch_5.ListA)  # -> Curve, Flag
replace_3 = ReplaceItems(List=replace, Item=flip_3.Curve, Indices=index_3, Wrap=False)
replace_4 = ReplaceItems(List=replace_2, Item=flip_4.Curve, Indices=index_4, Wrap=False)
end_5 = EndPoints(Curve=replace_4)  # -> Start, End
pdecon_8 = Deconstruct(Point=end_5.Start)  # -> XComponent, YComponent, ZComponent
panel_7 = Panel(pdecon_8.ZComponent)
pdecon_9 = Deconstruct(Point=end_5.End)  # -> XComponent, YComponent, ZComponent
panel_8 = Panel(pdecon_9.ZComponent)
subtraction_2 = Subtraction(A=pdecon_8.ZComponent, B=pdecon_9.ZComponent)
abs = Absolute(Value=subtraction_2)
smaller_4 = SmallerThan(FirstNumber=abs, SecondNumber=Slider(0.01, range=0..1))  # -> SmallerThan, OrEqualTo
dispatch_6 = Dispatch(List=replace_4, DispatchPattern=smaller_4.SmallerThan)  # -> ListA, ListB
index_5 = ItemIndex(List=replace_4, Item=dispatch_6.ListA)
flip_5 = FlipCurve(Curve=dispatch_6.ListA)  # -> Curve, Flag
replace_5 = ReplaceItems(List=replace_4, Item=flip_5.Curve, Indices=index_5, Wrap=False)
number_slider_2 = Slider(0.589749, range=0.001..1)
eval = EvaluateLength(Curve=replace_5, Length=number_slider_2, Normalized=True)  # -> Point, Tangent, Parameter
eval_2 = EvaluateLength(Curve=replace_3, Length=number_slider_2, Normalized=True)  # -> Point, Tangent, Parameter
merge_2 = Merge(Data1=flatten(eval.Point), Data2=flatten(eval_2.Point))
pt_5 = Point(graft(merge_2))
cps = ClosestPoints(Point=merge_2, Cloud=merge_2, Count=Slider(6, range=0..10))  # -> ClosestPoint, CPIndex, Distance
panel_9 = Panel(pt_5)
ln_4 = Line(StartPoint=merge_2, EndPoint=cps.ClosestPoint)
panel_10 = Panel(cps.CPIndex)
cps_2 = ClosestPoints(Point=merge_2, Cloud=cps.ClosestPoint, Count=Slider(6, range=0..10))  # -> ClosestPoint, CPIndex, Distance
panel_11 = Panel(cps_2.CPIndex)
intersection = SetIntersection(SetA=cps.CPIndex, SetB=cps_2.CPIndex)
panel_12 = Panel(intersection)
difference = SetDifference(SetA=intersection, SetB=pt_5)
vec_4 = VectorXYZ(XComponent=Slider(0, range=0..50), YComponent=Slider(0, range=0..50), ZComponent=Slider(0, range=0..50))  # -> Vector, Length
triangle = MeshTriangle(CornerA=pt_5, CornerB=cps.ClosestPoint, CornerC=difference)
triangle_2 = MeshTriangle(CornerA=pt_5, CornerB=cps.ClosestPoint, CornerC=difference)
panel_13 = Panel(difference)
item_4 = ListItem(List=panel_12, Index=Slider(2, range=0..10), Wrap=True)
item_5 = ListItem(List=panel_12, Index=Slider(1, range=0..10), Wrap=True)
item_6 = ListItem(List=panel_12, Index=Slider(0, range=0..10), Wrap=True)
pt_6 = Point(flatten(merge_2))
panel_14 = Panel(item_4)
panel_15 = Panel(item_5)
panel_16 = Panel(item_6)
item_7 = ListItem(List=pt_6, Index=item_5, Wrap=True)
item_8 = ListItem(List=pt_6, Index=item_4, Wrap=True)
item_9 = ListItem(List=pt_6, Index=item_6, Wrap=True)
merge_3 = Merge(Data1=item_9, Data2=item_7, Data3=item_8)
panel_17 = Panel(item_9)
del_4 = DelaunayMesh(Plane=PlaneXY(0, 0, 0))
triangle_3 = MeshTriangle(CornerA=item_9, CornerB=item_7, CornerC=item_8)
del_5 = DelaunayMesh(Points=merge_3, Plane=PlaneXY(0, 0, 0))
srfgrid = SurfaceFromPoints(Points=merge_3, Interpolate=False)
panel_18 = Panel(triangle_3)
