# Grasshopper definition shrink_obj.gh (Grasshopper 1.0.7)
# plug-ins: Kangaroo2 Components

number_slider = Slider(100, range=0..126)
geo = Geometry([<brep referenced from the Rhino model> x20])
hide_rhino_geo = GhPythonScript(Geo=geo, show=Toggle(True))  # inputs Geo: Guid, show: Boolean
# ---------- hide_rhino_geo: Python ----------
__author__ = "sator"
__version__ = "2023.05.24"

import rhinoscriptsyntax as rs
import Rhino as rh
import scriptcontext as sc
sc.doc = rh.RhinoDoc.ActiveDoc
if show:
    rs.HideObjects(Geo)
else:
    rs.ShowObjects(Geo)
# ---------- end hide_rhino_geo ----------
scale_nu = ScaleNU(Geometry=geo, Plane=PlaneXY(0, 0, 0), ScaleX=number_slider, ScaleY=number_slider, ScaleZ=number_slider)  # -> Geometry, Transform
vec = VectorXYZ(XComponent=0, YComponent=Slider(0, range=0..126), ZComponent=0)  # -> Vector, Length
move = Move(Geometry=scale_nu.Geometry, Motion=vec.Vector)  # -> Geometry, Transform
mesh = Mesh(move.Geometry)
number_slider_2 = Slider(15, range=0..748)
facec = FaceCircles(Mesh=mesh)  # -> Centers, Ratio
faceb = FaceBoundaries(Mesh=mesh)
pt = Point(facec.Centers)
item = ListItem(List=pt, Index=number_slider_2, Wrap=True)
crv = Curve(faceb)
item_2 = ListItem(List=crv, Index=number_slider_2, Wrap=True)
incurve = PointInCurve(Point=pt, Curve=faceb)  # -> Relationship, Point
pt_2 = Point(incurve.Point)
incurve_2 = PointInCurve(Point=pt, Curve=crv)  # -> Relationship, Point
equals = Equality(FirstNumber=incurve.Relationship, SecondNumber=Slider(0, range=0..2))  # -> Equality, Inequality
equals_2 = Equality(FirstNumber=incurve_2.Relationship, SecondNumber=Slider(0, range=0..2))  # -> Equality, Inequality
dispatch = Dispatch(List=pt_2, DispatchPattern=equals.Inequality)  # -> ListA, ListB
dispatch_2 = Dispatch(List=crv, DispatchPattern=equals_2.Inequality)  # -> ListA, ListB
crv_2 = Curve(dispatch_2.ListB)
explode = Explode(Curve=crv_2, Recursive=True)  # -> Segments, Vertices
line = Line(explode.Segments)
len = Length(Curve=line)
sort = SortList(Keys=len, ValuesA=line)  # -> Keys, ValuesA
crv_3 = Curve(dispatch_2.ListA)
pt_3 = Point(dispatch.ListA)
item_3 = ListItem(List=sort.ValuesA, Index=Slider(2, range=0..2), Wrap=True)
number_slider_3 = Slider(0.357, range=0.001..1)
longest_edge = Line(item_3)
explode_2 = Explode(Curve=crv_3, Recursive=True)  # -> Segments, Vertices
scale = Scale(Geometry=crv_3, Center=Point(0, 0, 0), Factor=number_slider_3)  # -> Geometry, Transform
scale_2 = Scale(Geometry=pt_3, Center=Point(0, 0, 0), Factor=number_slider_3)  # -> Geometry, Transform
circumcenter = Point(graft(pt_3))
line_2 = Line(explode_2.Segments)
crv_cp = CurveClosestPoint(Point=circumcenter, Curve=line_2)  # -> Point, Parameter, Distance
circumcenter_2 = Point(graft(circumcenter))
eval = EvaluateCurve(Curve=line_2, Parameter=crv_cp.Parameter)  # -> Point, Tangent, Angle
line_3 = Line(line_2)
panel = Panel(line_3)
drop_point_from_circumcenter_to_each_edg = Point(eval.Point)  # "drop point from circumcenter to each edge"
number_slider_4 = Slider(0, range=0..841)
end = EndPoints(Curve=line_2)  # -> Start, End
line_4 = Line(flatten(line_3))
panel_2 = Panel(line_4)
circumcenter_3 = Point(flatten(circumcenter_2))
number_slider_5 = Slider(2, range=0..6)
series = Series(Start=number_slider_4, Step=1, Count=Slider(3, range=0..841))  # -> graft(Series)
panel_3 = Panel(series)
item_4 = ListItem(List=circumcenter_3, Index=number_slider_4, Wrap=True)
item_5 = ListItem(List=line_4, Index=series, Wrap=True)
srf4pt = _4PointSurface(CornerA=circumcenter, CornerB=end.Start, CornerC=drop_point_from_circumcenter_to_each_edg)
srf4pt_2 = _4PointSurface(CornerA=circumcenter, CornerB=end.End, CornerC=drop_point_from_circumcenter_to_each_edg)
end_2 = EndPoints(Curve=item_5)  # -> Start, End
midpt = CurveMiddle(Curve=item_5)
pt1 = Point(end_2.Start)
dist = Distance(PointA=item_4, PointB=midpt)
dist_2 = Distance(PointA=item_4, PointB=pt1)
v_0v_1 = Number(dist)
v_0v_2 = Number(dist_2)
division = Division(A=v_0v_1, B=v_0v_2)
acos = ArcCosine(Value=division)
pi = Pi(Factor=1)
division_2 = Division(A=acos, B=pi)
multiplication = Multiplication(A=division_2, B="180")
inner_angle = Number(multiplication)
radius = Number(flatten(v_0v_2))
inner_angle_2 = Number(graft(inner_angle))
number_slider_6 = Slider(2, range=0..2)
item_6 = ListItem(List=inner_angle, Index=number_slider_6, Wrap=True)
radius_2 = Number(graft(radius))
multiplication_2 = Multiplication(A=inner_angle, B=number_slider_6)
item_7 = ListItem(List=radius, Index=Slider(0, range=0..1), Wrap=True)
panel_4 = Panel(multiplication_2)
panel_5 = Panel(radius_2)
num = Slider(0.276, range=0.001..10)
num_2 = Slider(0, range=0..2)
num_3 = Slider(180, range=0..180)
num_4 = Slider(0.2, range=0.01..0.5)
num_5 = Slider(0, range=0..20)
num_6 = Slider(0.304, range=0.1..0.99)
num_7 = Slider(0.629, range=0.1..0.99)
num_8 = Slider(0.703, range=0.1..0.99)
inner_angle_3 = Number(multiplication_2)
pleat_width_rate = Number(num_4)
pleat_position_s2 = Number(num_7)
pleat_position_s0 = Number(num_8)
pleat_position_s1 = Number(num_6)
extra_radius = Number(num_5)
radius_3 = Number(radius_2)
num_9 = Slider(9, range=0..20)
fold_angle = Number(num_3)
thickness = Number(num)
division_3 = Division(A=inner_angle_3, B="2")
shirinkable_structure = GhPythonScript(
    inner_angle=multiplication_2,
    radius=radius_2,
    extra_radius=num_5,
    pleat_width_rate=num_4,
    pleat_position_s0=num_8,
    pleat_position_s1=num_6,
    pleat_position_s2=num_7,
    fold_angle=num_3,
    thick=num,
    hinge_type=num_2)  # -> parts, current_radius, rate, s0, s1, s2
# ---------- shirinkable_structure: Python ----------
__author__ = "yohey_yamamort"
__version__ = "2020.03.27"

import math as m
import rhinoscriptsyntax as rs
import xml.etree.ElementTree as ET
        
        
#リスト変換用のおまじない
from clr import AddReference as addr
addr("Grasshopper")
from Grasshopper import DataTree
from Grasshopper.Kernel.Data import GH_Path
 


## ■geometry関数用
def getNormalization(v):
    size = m.sqrt(v[0]*v[0]+v[1]*v[1])
    return [v[0]/size,v[1]/size,0]

def getResize(v,size):
    normVec = getNormalization(v)
    return [normVec[0]*size,normVec[1]*size,0]

def getRotation(v, angle):
    toRad=3.141592/180
    x = v[0]*m.cos(angle*toRad)-v[1]*m.sin(angle*toRad)
    y = v[0]*m.sin(angle*toRad)+v[1]*m.cos(angle*toRad)
    return [x,y,0]

def getInterSectionPointLtoL(p1,v1,p2,v2):
    prm = 0
    if(v1[0]*v2[1]-v2[0]*v1[1]!=0):
        prm = p2[0]*v2[1]-p2[1]*v2[0]
        prm = prm - (p1[0]*v2[1]-p1[1]*v2[0])
        prm = prm / (v1[0]*v2[1]-v2[0]*v1[1])
        
        return rs.VectorAdd(p1,rs.VectorScale(v1,prm))
    
    return null


#■■折り紙構造のグラフ構造
#クラス：ノードとしての面
class faceNode:
    def __init__(self,_obj):
        self.obj = _obj #割り当てるべきオブジェクト（ポリゴン）
        self.hingeEdges =[] #ヒンジエッジのリスト
        self.points = [] #要素として計算する座標

        
    def addHingeEdge(self,hineE):
        #ヒンジを追加する
        self.hingeEdges.append(hineE)
    
    def addPoint(self,point):
        self.points.append(point)


    
    #fold処理の子処理
    def subFold(self,foldAngle,hingeStart,hingeEnd):
            
        #1.自身を折る
        vec = rs.VectorCreate(hingeStart,hingeEnd)
        rs.RotateObjects(self.obj,hingeStart,foldAngle,vec)
        
        #2.自身の要素を折る
        for point in self.points:
            rs.RotateObjects(point,hingeStart,foldAngle,vec)
        
        
        #3.子となるヒンジを折る
        for item in self.hingeEdges:
            if item.objPrev == self: #基準をselfとするヒンジ
                item.subFold(foldAngle,hingeStart,hingeEnd)

#クラス：エッジとしてのヒンジ
class hingeEdge:
    def __init__(self,_objPrev,_objNext,_vecStart,_vecEnd,_beSpanningEdge,_foldAngle):
        self.objPrev = _objPrev #（曲げ処理の基準，全域木としたとき親となる）一方のオブジェクト
        self.objNext = _objNext #（曲げ処理の対象，全域木としたとき子となる）もう一方のオブジェクト
        self.hingeStart = _vecStart #ヒンジの始点
        self.hingeEnd = _vecEnd #ヒンジの終点
        self.beSpanningEdge = _beSpanningEdge #全域木としたときのエッジであるか否か
        self.foldAngle = _foldAngle #折る際の折り角
        
        self.objPrev.addHingeEdge(self)
        self.objNext.addHingeEdge(self)
        

    #fold処理
    def fold(self):
        if self.beSpanningEdge == True: #全域木のエッジとなるヒンジ
            self.objNext.subFold(self.foldAngle,self.hingeStart,self.hingeEnd)
            

    #fold処理の子処理（アクセス制限をかけたい...）
    def subFold(self,foldAngle,hingeStart,hingeEnd):
        #1.自身を折る
        vec = rs.VectorCreate(hingeStart,hingeEnd)
        rs.RotateObjects(self.hingeStart,hingeStart,foldAngle,vec)
        rs.RotateObjects(self.hingeEnd,hingeStart,foldAngle,vec)
        
        #2.全域木の子に伝播する
        if self.beSpanningEdge == True: #全域木のエッジとなるヒンジ
            self.objNext.subFold(foldAngle,hingeStart,hingeEnd)


    def makePipeHinge(self,rateA,rateB,bePlayA,bePlayB,radius,thickness,sTheta,play,beSimple):
        
        rateA = rateA-0.001
        rateB = rateB-0.001
        
        hMid = rs.VectorAdd(self.hingeStart,rs.VectorScale(rs.VectorCreate(self.hingeEnd,self.hingeStart),0.5))
        hStart =rs.VectorAdd(hMid,rs.VectorScale(rs.VectorCreate(self.hingeEnd,self.hingeStart), rateA))
        hEnd =rs.VectorAdd(hMid,rs.VectorScale(rs.VectorCreate(self.hingeEnd,self.hingeStart), -rateB))
        length =rs.VectorLength(rs.VectorCreate(hEnd,hStart))
        hVec= rs.VectorScale(rs.VectorCreate(hEnd,hStart),1/length)
        
        if beSimple == True:
            #■基本となるパイプを作成
            pipeA= rs.AddPipe(rs.AddLine(rs.VectorAdd(hStart,rs.VectorScale(hVec,play*bePlayA)),rs.VectorAdd(hStart,rs.VectorScale(hVec,length-play*bePlayB))), 0, radius,0,1)
            reObjA = rs.BooleanUnion([pipeA,self.objPrev.obj],False)[0]
            self.objPrev.obj = reObjA
            
        else:
            #ヒンジの分割数を取得（仮に3とする）
            number = 1
            lStep = length/(2*number+1)
            
            #■角度制御用のクサビを作成
            
            #クサビの元となるパイプ
            wedge = rs.AddPipe(rs.AddLine(hStart,hEnd),0,radius+1.8,0,1)
            
            vec =  rs.VectorScale(rs.VectorRotate(hVec,-90,[0,0,1]),radius*2)
            p0 = rs.VectorAdd(hStart,vec)
            p1 = rs.VectorAdd(hStart,rs.VectorScale(vec,-1))
            p2 = rs.VectorAdd(p1,[0,0,-radius*2])
            p3 = rs.VectorAdd(p0,[0,0,-radius*2])
            dPoly = makePolygon([p0,p1,p2,p3],-length)
            d=1
            
            if sTheta<0:
                p2 = rs.VectorAdd(p1,[0,0,radius*2])
                p3 = rs.VectorAdd(p0,[0,0,radius*2])
                dPoly = makePolygon([p0,p3,p2,p1],-length)
                d=-1
            
            wedge=rs.BooleanDifference(wedge,dPoly,False)[0]
            dPoly = rs.RotateObject(dPoly,hStart,d*90-sTheta,hVec,True)
            wedge=rs.BooleanDifference(wedge,dPoly,False)[0]
            
            
            #■基本となるパイプを作成
            pipeA= rs.AddPipe(rs.AddLine(rs.VectorAdd(hStart,rs.VectorScale(hVec,0*lStep+play*bePlayA)),rs.VectorAdd(hStart,rs.VectorScale(hVec,1*lStep-play))), 0, radius,0,1)
            pipeB= rs.AddPipe(rs.AddLine(rs.VectorAdd(hStart,rs.VectorScale(hVec,1*lStep)),rs.VectorAdd(hStart,rs.VectorScale(hVec,2*lStep))), 0, radius,0,1)
            pipeC= rs.AddPipe(rs.AddLine(rs.VectorAdd(hStart,rs.VectorScale(hVec,2*lStep+play)),rs.VectorAdd(hStart,rs.VectorScale(hVec,3*lStep-play*bePlayB))), 0, radius,0,1)
            
            pipeADel= rs.AddPipe(rs.AddLine(rs.VectorAdd(hStart,rs.VectorScale(hVec,0*lStep)),rs.VectorAdd(hStart,rs.VectorScale(hVec,1*lStep))), 0, radius+play,0,1)
            pipeBDel= rs.AddPipe(rs.AddLine(rs.VectorAdd(hStart,rs.VectorScale(hVec,1*lStep-play)),rs.VectorAdd(hStart,rs.VectorScale(hVec,2*lStep+play))), 0, radius+play,0,1)
            pipeCDel= rs.AddPipe(rs.AddLine(rs.VectorAdd(hStart,rs.VectorScale(hVec,2*lStep)),rs.VectorAdd(hStart,rs.VectorScale(hVec,3*lStep))), 0, radius+play,0,1)
            
            pipeDel = rs.AddPipe(rs.AddLine(hStart,hEnd), 0, radius-thickness,0,1)
            pipeAdd = rs.AddPipe(rs.AddLine(rs.VectorAdd(hStart,rs.VectorScale(hVec,play*bePlayA)),rs.VectorAdd(hEnd,rs.VectorScale(hVec,-play*bePlayB))), 0, radius-thickness-play,0,1)
            
            #pipeA = rs.BooleanDifference(pipeA,pipeDel,False)[0]
            pipeB = rs.BooleanUnion([pipeB,pipeAdd],False)[0]
            #pipeC = rs.BooleanDifference(pipeC,pipeDel,False)[0]
            
            
            reObjA = rs.BooleanUnion([self.objPrev.obj,pipeA],False)[0]
            reObjA = rs.BooleanUnion([reObjA,pipeC],False)[0]
            if sTheta !=0:
                reObjA = rs.BooleanUnion([reObjA,wedge],False)[0]
    
            reObjA = rs.BooleanDifference(reObjA,pipeDel,False)[0]
            reObjA = rs.BooleanDifference(reObjA,pipeBDel,False)[0]
            self.objPrev.obj = reObjA
        
            reObjB = rs.BooleanDifference(self.objNext.obj,pipeADel,False)[0]
            reObjB = rs.BooleanDifference(reObjB,pipeCDel,False)[0]
            reObjB = rs.BooleanUnion([reObjB,pipeB],False)[0]
            self.objNext.obj = reObjB

## ■モデルの操作用
def makePolygon(vertices,dirVal):
    #頂点のリストから閉じたポリゴンを作る関数
    
    #1.基本となるsurfaceの作成
    curves =[]
    size = len(vertices)
    for index,item in enumerate(vertices):
        curves.append(rs.AddLine(item,vertices[(index+1)%size]))
    srf = rs.AddPlanarSrf(curves)
    
    #2.押し出す方向（法線方向）を取得
    normal = rs.SurfaceNormal(srf, [0,0]);

    normal = rs.VectorScale(normal, dirVal)
    normal_line = rs.AddLine(vertices[0], rs.VectorAdd(normal,vertices[0]))
    
    #3.押し出し処理＆出力
    return rs.ExtrudeSurface(srf,normal_line)

def shavePolygon(polygon,sPoint,ePoint,playSize):
    #bool演算の対象となパネルを作成
    inf = 10000
    
    mPoint = rs.VectorAdd(sPoint,ePoint)
    mPoint = rs.VectorScale(mPoint,1/2)
    
    vec = rs.VectorCreate(sPoint,ePoint)
    vec = rs.VectorScale(vec,1/rs.VectorLength(vec))#単位ベクトル化
    
    x0 =rs.VectorScale(rs.VectorRotate(vec,90,[0,0,1]),playSize/2)
    x1 =rs.VectorScale(rs.VectorRotate(vec,-90,[0,0,1]),playSize/2)
    y0 =rs.VectorAdd(rs.VectorScale(vec,inf),[0,0,inf])
    y1 =rs.VectorAdd(rs.VectorScale(vec,-inf),[0,0,inf])    

    vertices =[]
    vertices.append(rs.VectorAdd(mPoint,rs.VectorAdd(x0,y0)))
    vertices.append(rs.VectorAdd(mPoint,rs.VectorAdd(x0,y1)))
    vertices.append(rs.VectorAdd(mPoint,rs.VectorAdd(x1,y1)))
    vertices.append(rs.VectorAdd(mPoint,rs.VectorAdd(x1,y0)))
    shaveArea = makePolygon(vertices,-2*inf)
    
    return rs.BooleanDifference(polygon,shaveArea,False)[0]





## ■モジュールの操作用
#クラス：strModule(structure module) 構造物のサブ分子
class strModule:
    #def __init__(self,iAngle,radius,sRate,d1Rate,d2Rate,thickA,thickB,thickC,foldAngle,hasHinge):
    def __init__(self,iAngle,radius,extraRadius,sRate,s0,s1,s2,thick,foldAngle,hingeType):
        #iAngle(Internal angle)内角
        #radius；外接円に配置した時の半径
        #sRate (shrink rate) 作図の際の収縮率（0<sRate<0.5）
        #theta 変形用パラメータ
        #foldAngle 折り状態のパラメータ
        
        #■ １．初期計算
        toRad=3.141592/180
        
        #モジュールの内角
        phi0= iAngle/2
        phi1= 90
        phi2= 90-iAngle/2
        
        #theta = phi2
        L0 = radius*m.sin(phi2*toRad)
        L1 = radius*m.cos(phi2*toRad)
        L2 = radius
        
        #パーツ間の遊び
        playSize =0.10
        playSizeSub = 1.0
        
        v0=[0,0]
        v1=[0,-L0]
        v2=[L1,-L0]
        
        vec_u0 = rs.VectorCreate(v1,v0)
        vec_u1 = rs.VectorCreate(v2,v1)
        vec_u2 = rs.VectorCreate(v0,v2)
        
        vec_u0_perp = getRotation(vec_u0 ,90)
        vec_u1_perp = getRotation(vec_u1 ,90)
        vec_u2_perp = getRotation(vec_u2 ,90)


        #s1の値を適切なものに修正
        endpointVecX =getInterSectionPointLtoL(v2,vec_u2, rs.VectorAdd(v0,rs.VectorScale(vec_u0,s0)), vec_u0_perp)
        endpointVecX =getInterSectionPointLtoL(v1,vec_u1,endpointVecX,vec_u1_perp)
        endpointVecX = rs.VectorAdd(endpointVecX,rs.VectorScale(v1,-1))
        endpointX = rs.VectorLength(endpointVecX)/rs.VectorLength(vec_u1) -0.05
        if s1>endpointX:
            s1=endpointX
        
        #s2の値を適切なもの(ねじり面を全体の内側に収めるもの)に修正
        basePoint =getInterSectionPointLtoL(rs.VectorAdd(v0,rs.VectorScale(vec_u0,s0)),vec_u0_perp ,rs.VectorAdd(v1,rs.VectorScale(vec_u1,s1)),vec_u1_perp)
        endpointVecA =getInterSectionPointLtoL(v2,vec_u2, basePoint, vec_u2_perp)
        endpointVecB =getInterSectionPointLtoL(v2,vec_u2, rs.VectorAdd(v0,rs.VectorScale(vec_u0,s0)), vec_u2_perp)
        endpointVecC =getInterSectionPointLtoL(v2,vec_u2, rs.VectorAdd(v1,rs.VectorScale(vec_u1,s1)), vec_u1_perp)
        
        endpointVecA = rs.VectorAdd(endpointVecA,rs.VectorScale(v2,-1))
        endpointVecB = rs.VectorAdd(endpointVecB,rs.VectorScale(v2,-1))
        endpointVecC = rs.VectorAdd(endpointVecC,rs.VectorScale(v2,-1))
        
        endpointA = rs.VectorLength(endpointVecA)/radius +0.01
        endpointB = rs.VectorLength(endpointVecB)/radius -0.01
        endpointC = rs.VectorLength(endpointVecC)/radius -0.01
        
        if endpointC < endpointB:
            endpointB = endpointC
        
        if s2<endpointA:
            s2=endpointA
        elif s2>endpointB:
            s2=endpointB
        
        if endpointB -endpointA <0.01:
            s2 = (endpointB+endpointA)/2
        
        
        
        #■ ２．各頂点座標を決定（）
        q0=rs.VectorAdd(v0,rs.VectorScale(vec_u0,(1-sRate)*s0))
        q1=rs.VectorAdd(q0,rs.VectorScale(vec_u0,sRate) )
        q2=rs.VectorAdd(v1,rs.VectorScale(vec_u1,(1-sRate)*s1))
        q3=rs.VectorAdd(q2,rs.VectorScale(vec_u1,sRate) )
        q4=rs.VectorAdd(v2,rs.VectorScale(vec_u2,(1-sRate)*s2))
        q5=rs.VectorAdd(q4,rs.VectorScale(vec_u2,sRate) )
        
        p0=getInterSectionPointLtoL(q0,vec_u0_perp ,q5,vec_u2_perp)
        p1=getInterSectionPointLtoL(q2,vec_u1_perp ,q1,vec_u0_perp)
        p2=getInterSectionPointLtoL(q4,vec_u2_perp ,q3,vec_u1_perp)
        
        theta = rs.VectorAngle(rs.VectorCreate(p0,p1),rs.VectorCreate(q1,p1))
        
        w0=getInterSectionPointLtoL(p1,getRotation(rs.VectorCreate(p2,p1),-(90-theta)),p2,rs.VectorCreate(q3,p2))
        w1=getInterSectionPointLtoL(p1,getRotation(rs.VectorCreate(p0,p1),-theta),p2,rs.VectorCreate(p0,p2))
        
        exV2=[(radius+extraRadius)*m.cos(phi2*toRad),-(radius+extraRadius)*m.sin(phi2*toRad)]
        exQ3=getInterSectionPointLtoL(exV2,vec_u1 ,q3,vec_u1_perp)
        
        #各種変更後のパラメータ
        self.sRate = sRate/(1+(extraRadius/radius))
        
        self.s0 = s0/(1+(extraRadius/radius))
        self.s1 = s1/(1+(extraRadius/radius))
        self.s2 = ((extraRadius/radius)+s2)/((extraRadius/radius)+1)
        
        
        
        #■■ ３．各面＆パーツを決定
        #thickA,thickB,thickC
        thickA = thick
        thickB = thick
        thickC = thick
        thickD = thickB * L2/L1
        thickE = thickC *m.sin(m.radians(theta)) /m.sin(m.radians(90))
        thickF = thickB
        
        subThick = thickD-thickA
        
        panel0=makePolygon([v0,q5,p0,q0],-thickA)
        if hingeType==2:
            panel0=shavePolygon(panel0,q0,p0,playSize)
            panel0=shavePolygon(panel0,q5,p0,playSize)
        
        panel1=makePolygon([q5,q4,p2,p0],-thickD)
        if hingeType==2:
            panel1=shavePolygon(panel1,q5,p0,playSize)
            panel1=shavePolygon(panel1,p2,q4,playSize)
            panel1=shavePolygon(panel1,p0,p2,playSize)
        
        panel2 = makePolygon([exV2,exQ3,p2,q4],-thickA)
        panel2 = rs.MoveObject(panel2,[0,0,subThick])
        if hingeType==2:
            panel2 =shavePolygon(panel2,p2,q4,playSize)
            panel2 =shavePolygon(panel2,p2,q3,playSize)
        
        panel3 = makePolygon([p2,w0,p1],-thickB-thickE)
        panel3 = rs.BooleanUnion([panel3,makePolygon([p2,q3,q2,p1],-thickB)],False)[0]
        panel3 = rs.MoveObject(panel3,[0,0,subThick])
        if hingeType==2:
            panel3 =shavePolygon(panel3,p2,q3,playSize)
            panel3 =shavePolygon(panel3,p1,p2,playSize)
            panel3 =shavePolygon(panel3,p1,q2,playSize)
            panel3 =shavePolygon(panel3,p2,p0,playSizeSub)
        
        panel4 = makePolygon([w1,p2,p1],-thickF-thickC)
        panel4 = rs.BooleanUnion([panel4,makePolygon([p0,p2,p1],-thickF)],False)[0]
        panel4 = rs.MoveObject(panel4,[0,0,-thickC+thickE +subThick])
        if hingeType==2:
            panel4 =shavePolygon(panel4,p0,p1,playSize)
            panel4 =shavePolygon(panel4,p1,p2,playSize)
            panel4 =shavePolygon(panel4,p2,p0,playSizeSub)
        
        panel5=makePolygon([q0,p0,p1,q1],-thickE)
        rs.MoveObject(panel5,[0,0,-thickC+thickB+subThick])
        if hingeType==2:
            panel5 =shavePolygon(panel5,p0,p1,playSize)
            panel5 =shavePolygon(panel5,p0,q0,playSizeSub)
            panel5 =shavePolygon(panel5,p1,q1,playSize)
        
        panel6=makePolygon([p1,q2,v1,q1],-thickC)
        rs.MoveObject(panel6,[0,0,-thickC+thickB+subThick])
        
        
        #■■ ４．折り状態の決定
        #折り角の取得(厚みが存在していることに注意)
        miniAngle = m.atan(thickB/rs.VectorLength(rs.VectorCreate(q2,q3)))/toRad
        if foldAngle < miniAngle:
            foldAngle = miniAngle
        
        K = (1-m.tan(m.radians(theta/2)) * m.tan(m.radians(90/2)))/(1+m.tan(m.radians(theta/2)) * m.tan(m.radians(90/2)))
        
        fAngle0 = -foldAngle
        fAngle1 = foldAngle
        
        fAngle2 = -foldAngle
        fAngle3 = m.degrees( m.atan( K * m.tan(m.radians(foldAngle/2)))*2)
        fAngle4 = foldAngle
        fAngle5 = -m.degrees( m.atan( K * m.tan(m.radians(foldAngle/2)))*2)
        fAngle6 = -foldAngle
        
        #rootNode = None #ルートとしてのノード
        gNodes = [] #グラフのノードのリスト
        gNodes.append(faceNode(panel0))
        gNodes.append(faceNode(panel1))
        gNodes.append(faceNode(panel2))
        gNodes.append(faceNode(panel3))
        gNodes.append(faceNode(panel4))
        gNodes.append(faceNode(panel5))
        gNodes.append(faceNode(panel6))
        
        #（半径算出用）頂点の記憶
        gNodes[0].addPoint(rs.AddPoint(v0))
        gNodes[2].addPoint(rs.AddPoint(rs.VectorAdd(exV2,[0,0,subThick])))
        gNodes[6].addPoint(rs.AddPoint(rs.VectorAdd(v1,[0,0,-thickC+thickB+subThick])))
        
        gEdges = [] #エッジのノードのリスト
        gEdges.append( hingeEdge(gNodes[0],gNodes[1],rs.AddPoint(p0),rs.AddPoint(q5),True,fAngle0))
        gEdges.append( hingeEdge(gNodes[1],gNodes[2],rs.AddPoint(rs.VectorAdd(p2,[0,0,thickD])),rs.AddPoint(rs.VectorAdd(q4,[0,0,thickD])),True,fAngle1))
        gEdges.append( hingeEdge(gNodes[2],gNodes[3],rs.AddPoint(rs.VectorAdd(p2,[0,0,subThick])),rs.AddPoint(rs.VectorAdd(q3,[0,0,subThick])),True,fAngle2))
        gEdges.append( hingeEdge(gNodes[3],gNodes[4],rs.AddPoint(rs.VectorAdd(p2,[0,0,thickB+thickE+subThick])),rs.AddPoint(rs.VectorAdd(p1,[0,0,thickB+thickE+subThick])),True,fAngle3))
        gEdges.append( hingeEdge(gNodes[4],gNodes[5],rs.AddPoint(rs.VectorAdd(p0,[0,0,thickE-thickC+thickB+subThick])),rs.AddPoint(rs.VectorAdd(p1,[0,0,thickE-thickC+thickB+subThick])),True,fAngle4))
        gEdges.append( hingeEdge(gNodes[5],gNodes[6],rs.AddPoint(rs.VectorAdd(q1,[0,0,-thickC+thickB+subThick])),rs.AddPoint(rs.VectorAdd(p1,[0,0,-thickC+thickB+subThick])),True,fAngle5))
        gEdges.append( hingeEdge(gNodes[6],gNodes[3],rs.AddPoint(rs.VectorAdd(q2,[0,0,thickB+subThick])),rs.AddPoint(rs.VectorAdd(p1,[0,0,thickB+subThick])),False,fAngle6))
        
        
        #ヒンジの描写出力に関する処理
        hRadius = 1.8
        hThickness = 0.9
        
        if hingeType>0:
            beSimple = hingeType==1
            gEdges[0].makePipeHinge(0.5,0.3,1,1,hRadius,hThickness,miniAngle,playSize,beSimple)
            gEdges[1].makePipeHinge(0.5,0.5,0,1,hRadius,hThickness,-miniAngle,playSize,beSimple)
            gEdges[2].makePipeHinge(0.5,0.1,0,1,hRadius,hThickness,miniAngle,playSize,beSimple)
            gEdges[3].makePipeHinge(0.25,0.2,1,1,hRadius,hThickness,0,playSize,beSimple)
            gEdges[4].makePipeHinge(0.25,0.25,1,1,hRadius,hThickness,0,playSize,beSimple)
            gEdges[5].makePipeHinge(-0.25,0.5,1,0,hRadius,hThickness,0,playSize,beSimple)
            gEdges[6].makePipeHinge(0.45,0.5,1,0,hRadius,hThickness,-miniAngle,playSize,beSimple)
        
        #折り処理
        for gEdge in gEdges:
            gEdge.fold()
        
        
        #■■ ５．メンバ変数出力に関する処理
        self.parts =[] #各パーツ
        self.circumradius=0 #外接半径
        
        v0Hat = rs.PointCoordinates(gNodes[0].points[0])
        v1Hat = rs.PointCoordinates(gNodes[6].points[0])
        v2Hat = rs.PointCoordinates(gNodes[2].points[0])
        self.circumradius=rs.VectorLength([v0Hat[0]-v2Hat[0],v0Hat[1]-v2Hat[1]])#外接半径
        
        
        hMoveVec=[0,0,-v2Hat[2]]
        mParts =[] #モジュ―ルとしてのパーツ
        for gNode in gNodes:
            mParts.append(rs.MoveObject(gNode.obj,hMoveVec))
        
        
        
        
        #出力用データの作成
        subParts=rs.MirrorObjects(mParts,[0,0,0],[0,-100,0],True)
        mParts[0] = rs.BooleanUnion([mParts[0],subParts[0]],False)[0]
        mParts[6] = rs.BooleanUnion([mParts[6],subParts[6]],False)[0]
        mParts[5] = rs.BooleanUnion([mParts[5],subParts[5]],False)[0]
        
        self.rParts=[] #右側のパーツ（3種）
        self.lParts=[] #左側のパーツ（3種）
        self.cParts=[] #制御用のパーツ（6種）
        
        self.rParts.append(mParts[0])
        self.rParts.append(mParts[1])
        self.rParts.append(mParts[2])
        
        self.lParts.append(mParts[0])
        self.lParts.append(subParts[1])
        self.lParts.append(subParts[2])
        
        self.cParts.append(mParts[3])
        self.cParts.append(mParts[4])
        self.cParts.append(mParts[5])
        self.cParts.append(mParts[6])
        self.cParts.append(subParts[3])
        self.cParts.append(subParts[4])
        
        self.parts = mParts
        self.parts.append(subParts[1])
        self.parts.append(subParts[2])
        self.parts.append(subParts[3])
        self.parts.append(subParts[4])



#################################################


toRad=3.141592/180

#分子の作成
base = strModule(inner_angle,radius,extra_radius,pleat_width_rate,pleat_position_s0,pleat_position_s1,pleat_position_s2,thick,fold_angle,hinge_type)
parts = base.parts

current_radius = base.circumradius
rate=base.sRate
s0=base.s0
s1=base.s1
s2=base.s2
# ---------- end shirinkable_structure ----------
phi0 = Number(division_3)
subtraction = Subtraction(A="90", B=phi0)
phi1 = Number("90")
phi2 = Number(subtraction)
rad = Radians(Degrees=phi2)
panel_6 = Panel(shirinkable_structure.current_radius)
panel_7 = Panel(shirinkable_structure.s0)
panel_8 = Panel(shirinkable_structure.s1)
panel_9 = Panel(shirinkable_structure.s2)
panel_10 = Panel(shirinkable_structure.rate)
cos = Cosine(Value=rad)
sin = Sine(Value=rad)
item_8 = ListItem(List=shirinkable_structure.parts, Index=Slider(0, range=0..58), Wrap=True)
multiplication_3 = Multiplication(A=radius_3, B=sin)
multiplication_4 = Multiplication(A=radius_3, B=cos)
swatch = ColourSwatch(SwatchColor=RGB(255, 255, 255))
debrep = DeconstructBrep(Brep=item_8)  # -> Faces, Edges, Vertices
l0 = Number(multiplication_3)
l2 = Number(rad)
l1 = Number(multiplication_4)
panel_11 = Panel(shirinkable_structure.parts)
foot_of_perpendicular = Point(midpt)
bottom_line = Line(item_5)
pt_4 = Point(item_4)
subtraction_2 = Subtraction(A="0", B=l0)
subtraction_3 = Subtraction(A="0", B=l0)
item_9 = ListItem(List=debrep.Vertices, Index=Slider(1, range=0..58), Wrap=True)
vec_2 = VectorXYZ(XComponent="0", YComponent="0", ZComponent=0)  # -> Vector, Length
vec_3 = VectorXYZ(XComponent=l1, YComponent=subtraction_2, ZComponent=0)  # -> Vector, Length
vec_4 = VectorXYZ(XComponent="0", YComponent=subtraction_3, ZComponent=0)  # -> Vector, Length
vec2pt = Vector2Pt(PointA=item_9, PointB=pt_4, Unitize=False)  # -> Vector, Length
v0 = Vector(vec_2.Vector)
v1 = Vector(vec_4.Vector)
v2 = Vector(vec_3.Vector)
move_2 = Move(Geometry=shirinkable_structure.parts, Motion=vec2pt.Vector)  # -> Geometry, Transform
subtraction_4 = Subtraction(A=v1, B=v0)
subtraction_5 = Subtraction(A=v2, B=v1)
subtraction_6 = Subtraction(A=v0, B=v2)
item_10 = ListItem(List=move_2.Geometry, Index=Slider(6, range=0..58), Wrap=True)
rotate = Rotate(Geometry=subtraction_4, Angle="90", Plane=PlaneXY(0, 0, 0))  # -> Geometry, Transform
rotate_2 = Rotate(Geometry=subtraction_6, Angle="90", Plane=PlaneXY(0, 0, 0))  # -> Geometry, Transform
debrep_2 = DeconstructBrep(Brep=item_10)  # -> Faces, Edges, Vertices
rotate_3 = Rotate(Geometry=subtraction_5, Angle="90", Plane=PlaneXY(0, 0, 0))  # -> Geometry, Transform
vec_u0_perp = Vector(rotate.Geometry)
vec_u1_perp = Vector(rotate_3.Geometry)
vec_u2_perp = Vector(rotate_2.Geometry)
item_11 = ListItem(List=debrep_2.Vertices, Index=Slider(31, range=0..36), Wrap=True)
vec2pt_2 = Vector2Pt(PointA=foot_of_perpendicular, PointB=pt_4, Unitize=False)  # -> Vector, Length
ln = Line(StartPoint=foot_of_perpendicular, EndPoint=pt_4)
ln_2 = Line(StartPoint=item_11, EndPoint=pt_4)
vec2pt_3 = Vector2Pt(PointA=item_11, PointB=pt_4, Unitize=False)  # -> Vector, Length
angle = Angle(VectorA=ln_2, VectorB=ln)  # -> Angle, Reflex
xprod = CrossProduct(VectorA=vec2pt_3.Vector, VectorB=vec2pt_2.Vector, Unitize=False)  # -> Vector, Length
rot3d = Rotate3D(Geometry=move_2.Geometry, Angle=angle.Angle, Center=pt_4, Axis=xprod.Vector)  # -> Geometry, Transform
foot_of_perpendicular_2 = Point(foot_of_perpendicular)
item_12 = ListItem(List=rot3d.Geometry, Index=Slider(8, range=0..58), Wrap=True)
bottom_line_2 = Line(bottom_line)
pt_5 = Point(pt_4)
debrep_3 = DeconstructBrep(Brep=item_12)  # -> Faces, Edges, Vertices
end_3 = EndPoints(Curve=bottom_line_2)  # -> Start, End
item_13 = ListItem(List=debrep_3.Vertices, Index=Slider(1, range=0..36), Wrap=True)
dist_3 = Distance(PointA=end_3.End, PointB=pt_5)
vec2pt_4 = Vector2Pt(PointA=pt_5, PointB=item_13, Unitize=Toggle(True))  # -> Vector, Length
number_slider_7 = Slider(0.300019, range=0..2)
multiplication_5 = Multiplication(A=vec2pt_4.Vector, B=dist_3)
addition = Addition(A=pt_5, B=multiplication_5)
pt_6 = Point(addition)
foldangle = FoldAngle(P1=pt_5, P2=foot_of_perpendicular_2, P3=pt_6, P4=end_3.End)
subtraction_7 = Subtraction(A="0", B=foldangle)
rot3d_2 = Rotate3D(Geometry=rot3d.Geometry, Angle=subtraction_7, Center=foot_of_perpendicular_2, Axis=vec2pt_2.Vector)  # -> Geometry, Transform
panel_12 = Panel(rot3d_2.Geometry)
